# Grasshopper definition dsChallenge.gh (Grasshopper 1.0.8)
# plug-ins: RhinoCodePluginGH, eleFront, IPMSpatialAnalysis

files = ListFiles(Folder="C:\Users\tobyw\SpatterData\DSC", SearchMask="*.csv", recursive=True)
split = TextSplit(Text=files, Separators="\")
item = ListItem(List=split, Index=Slider(5, range=0..7), Wrap=False)  # -> flatten(Item)
py3 = Python3Script(s=item)  # -> out, a; inputs s: list
# ---------- py3: Python ----------
import re

a = []

for item in s:
    nums = re.findall(r"\d+", item)
    a.append(float(nums[0]))
# ---------- end py3 ----------
sort = SortList(Keys=py3.a, ValuesA=files)  # -> Keys, ValuesA
multiplication = Multiplication(A=sort.Keys, B=Slider(0.05, range=0..0.1))
dom = ConstructDomain(DomainStart=Slider(1000, range=1000..10000), DomainEnd=Slider(3000, range=1000..10000))
voxelisedata = VoxeliseData(
    Input=sort.ValuesA,
    XColumnName="x",
    YColumnName="y",
    DataColumnName="SignalPdInGaAs",
    LayerHeights=multiplication,
    PointReadInterval=1,
    VoxelSize=Slider(0.15, range=0.1..1.1),
    ValueInterval=dom,
    Method=1,
    ExtractionRadius=1,
    Reset=False)
spatialcorrelation = SpatialCorrelation(VoxelData=voxelisedata, VoxelRadius=1)
dom_2 = ConstructDomain(DomainStart=Slider(1.645, range=-22..17), DomainEnd=Slider(67, range=-22..67))
panel = Panel("Standard Dev.")
filtervoxels = FilterVoxels(VoxelData=spatialcorrelation, ScalarRange=dom_2, RemoveZeros=False, Normalise=False)
panel_2 = Panel("Mean")
explodevoxels = ExplodeVoxels(VoxelData=spatialcorrelation)  # -> VoxelCentres, VoxelIndices, VoxelValues
bnd = Bounds(Numbers=explodevoxels.VoxelValues)
voxelpreview = VoxelPreview(VoxelData=filtervoxels, ScalarRange=bnd, PointWeight=Slider(3, range=1..10), ColourbarTitle="Spat. Corr")
