# Grasshopper definition test.gh (Grasshopper 1.0.8)
# plug-ins: RhinoCodePluginGH, treesloth01, Dodo, Labrador, eleFront, Wombat, IPMSpatialAnalysis

reread = Button()
# Settings
start_layer_idx = Slider(5, range=0..294)
end_layer_idx = Slider(294, range=0..294)
layer_height = Slider(0.05, range=0..0.1)
point_read_interval = Slider(4, range=1..20)
voxel_size = Slider(0.3, range=0.2..1)

mesh = Mesh([<mesh referenced from the Rhino model> x227])
mesh_2 = Mesh([<mesh referenced from the Rhino model> x215])
mesh_3 = Mesh([<mesh referenced from the Rhino model> x203])
mesh_4 = Mesh([<mesh referenced from the Rhino model> x188])
mesh_5 = Mesh([<mesh referenced from the Rhino model> x183])
mesh_6 = Mesh([<mesh referenced from the Rhino model> x179])

mesh_7 = Mesh([<mesh referenced from the Rhino model> x408])
mesh_8 = Mesh([<mesh referenced from the Rhino model> x417])
mesh_9 = Mesh([<mesh referenced from the Rhino model> x416])
mesh_10 = Mesh([<mesh referenced from the Rhino model> x817])
mesh_11 = Mesh([<mesh referenced from the Rhino model> x967])
mesh_12 = Mesh([<mesh referenced from the Rhino model> x777])
entwine = Entwine(Branch00=mesh, Branch01=mesh_2, Branch02=mesh_3, Branch03=mesh_4, Branch04=mesh_6, Branch05=mesh_5, FlattenInputs=True)
entwine_2 = Entwine(
    Branch00=mesh_9,
    Branch01=mesh_7,
    Branch02=mesh_8,
    Branch03=mesh_10,
    Branch04=mesh_11,
    Branch05=mesh_12,
    FlattenInputs=True)
settings = CreateSettings(VoxelSize=Slider(0.02, range=0.01..0.5), Adaptivity=Slider(0, range=0..1))
number_slider = Slider(0, range=0..0.5)
mjoin = MeshJoin(Meshes=entwine_2)
frommesh = CreateFromMesh(Mesh=mjoin, Settings=settings)
neg = Negative(Value=number_slider)
doubleoffset = DoubleOffset(Volume=frommesh, Offset1=number_slider, Offset2=neg, Settings=settings)
number_slider_2 = Slider(0.0081, range=0..0.0081)
volumetomesh = VolumeToMesh(Volume=doubleoffset)
disjoint = DisjointMesh(Mesh=volumetomesh)
volume = Volume(Geometry=disjoint)  # -> Volume, Centroid
smaller = SmallerThan(FirstNumber=volume.Volume, SecondNumber=number_slider_2)  # -> SmallerThan, OrEqualTo
larger = LargerThan(FirstNumber=volume.Volume, SecondNumber=number_slider_2)  # -> LargerThan, OrEqualTo
cull = CullPattern(List=disjoint, CullPattern=smaller.SmallerThan)
cull_2 = CullPattern(List=volume.Volume, CullPattern=smaller.SmallerThan)
bnd = Bounds(Numbers=flatten(volume.Volume))
flatten = FlattenTree(Tree=cull_2, Path="{0}")
remap = RemapNumbers(Value=flatten, Source=bnd, Target=Domain(0, 1))  # -> Mapped, Clipped
flatten_2 = FlattenTree(Tree=cull, Path="{0}")  # disabled
gradient = Gradient(LowerLimit=0, UpperLimit=1, Parameter=remap.Mapped, stops=[0: RGB(0, 128, 0), 0.5: RGB(255, 255, 0), 1: RGB(255, 0, 0)])  # disabled
bar_graph = BarGraph(flatten, BarColor=RGB(255, 0, 90))
mcol = MeshColours(Mesh=graft(flatten_2), Colours=graft(gradient))  # disabled

panel = Panel("""1
2
3
7
8
9""")
panel_2 = Panel("""4
5
6
10
11
12""")

number_slider_3 = Slider(6, range=1..8)
# File Management
panel_3 = Panel("C:\Users\tobyw\SpatterData\Low\")
panel_4 = Panel("G:\My Drive\PHD\Data\IPM\Lattices\MAT\")
series = Series(Start=1, Step=1, Count=Slider(12, range=1..12))
series_2 = Series(Start=1, Step=1, Count=Slider(6, range=1..6))
file_path = FilePath("C:\Users\tobyw\SpatterData\High\")
text = Text(panel_2)
file_path_2 = FilePath(panel_3)
text_2 = Text(series)
concat = Concatenate(FragmentA=file_path, FragmentB=text)
concat_2 = Concatenate(FragmentA=file_path_2, FragmentB=text_2)
list_files = ListFiles(Folder=concat, SearchMask="*.csv", recursive=True)
shift = ShiftPaths(Data=list_files, Offset=Slider(1, range=-2..2))
text_split = TextSplit(Text=shift, Separators="_")
list_item = ListItem(List=text_split, Index="1", Wrap=True)
pshift = ShiftPaths(Data=list_item, Offset=-1)
dom = ConstructDomain(DomainStart=start_layer_idx, DomainEnd=end_layer_idx)
sort_list = SortList(Keys=pshift, ValuesValuesA=shift)  # -> Keys, ValuesValuesA
multiplication = Multiplication(A=sort_list.Keys, B=layer_height)
subset = SubList(List=multiplication, Domain=dom, Wrap=False)  # -> List, Index
subset_2 = SubList(List=sort_list.ValuesValuesA, Domain=dom, Wrap=False)  # -> List, Index

entwine_3 = Entwine(
    Branch00=mesh,
    Branch01=mesh_2,
    Branch02=mesh_3,
    Branch03=mesh_9,
    Branch04=mesh_7,
    Branch05=mesh_8,
    Branch06=mesh_4,
    Branch07=mesh_6,
    Branch08=mesh_5,
    Branch09=mesh_10,
    Branch010=mesh_11,
    Branch011=mesh_12,
    FlattenInputs=True)

pshift_2 = ShiftPaths(Data=subset.List, Offset=-1)
pshift_3 = ShiftPaths(Data=subset_2.List, Offset=-1)
voxelisedata = VoxeliseData(
    Input=pshift_3,
    XColumnName="GalvoXActualCartesian",
    YColumnName="GalvoYActualCartesian",
    DataColumnName="Photodiode1Normalised",
    LayerHeights=pshift_2,
    PointReadInterval=point_read_interval,
    VoxelSize=voxel_size,
    Method=1,
    ExtractionRadius=1,
    Reset=reread)

voxelisedata_2 = VoxeliseData(
    Input=subset_2.List,
    XColumnName="GalvoXActualCartesian",
    YColumnName="GalvoYActualCartesian",
    DataColumnName="Photodiode1Normalised",
    LayerHeights=subset.List,
    PointReadInterval=point_read_interval,
    VoxelSize=voxel_size,
    Method=1,
    ExtractionRadius=1,
    Reset=reread)  # disabled
list = ValueList({"Exp": 0, "Sqrt": 1}, selected="Exp")
log = CSharpScript(f=list)  # -> out, a; inputs f: Int32
# ---------- log: C# ----------
// Grasshopper Script Instance
#region Usings
using System;
using System.Linq;
using System.Collections;
using System.Collections.Generic;
using System.Drawing;

using Rhino;
using Rhino.Geometry;

using Grasshopper;
using Grasshopper.Kernel;
using Grasshopper.Kernel.Data;
using Grasshopper.Kernel.Types;
#endregion

public class Script_Instance : GH_ScriptInstance
{
    #region Notes
    /* 
      Members:
        RhinoDoc RhinoDocument
        GH_Document GrasshopperDocument
        IGH_Component Component
        int Iteration

      Methods (Virtual & overridable):
        Print(string text)
        Print(string format, params object[] args)
        Reflect(object obj)
        Reflect(object obj, string method_name)
    */
    #endregion

    static double Threshold;
    static Func<double, double> DelegateFunction;

    private void RunScript(int f, ref object a)
    {
        Func<double, double> fun;

        switch (f)
        {
            case 0:
                fun = new Func<double, double>(Exponent);
                break;
            
            case 1:
                fun = new Func<double, double>(Sqrt);
                break;
            
            default:
                goto case 0;
        }

        a = fun;
    }

    static double Exponent(double v)
    {
        return Math.Log(v);
    }

    static double Sqrt(double v)
    {
        return Math.Sqrt(v);
    }
}
# ---------- end log ----------
dom_2 = ConstructDomain(DomainStart=Slider(25, range=0..302), DomainEnd=Slider(50, range=0..502))

number_slider_4 = Slider(0.5, range=0..1)  # disabled
columnnormalisation = ColumnNormalisation(VoxelData=voxelisedata_2)  # disabled
spatialcorrelation = SpatialCorrelation(VoxelData=columnnormalisation, VoxelRadius=1)  # disabled
weightedsumdelegate = WeightedSumDelegate(Weight=number_slider_4)  # -> out, F; inputs Weight: Double; disabled
# ---------- weightedsumdelegate: C# ----------
// Grasshopper Script Instance
#region Usings
using System;
using System.Linq;
using System.Collections;
using System.Collections.Generic;
using System.Drawing;

using Rhino;
using Rhino.Geometry;

using Grasshopper;
using Grasshopper.Kernel;
using Grasshopper.Kernel.Data;
using Grasshopper.Kernel.Types;
#endregion

public class Script_Instance : GH_ScriptInstance
{
    #region Notes
    /* 
      Members:
        RhinoDoc RhinoDocument
        GH_Document GrasshopperDocument
        IGH_Component Component
        int Iteration

      Methods (Virtual & overridable):
        Print(string text)
        Print(string format, params object[] args)
        Reflect(object obj)
        Reflect(object obj, string method_name)
    */
    #endregion

    public static double _weight;
    public static Func<double, double, double> _func;

    private void RunScript(double Weight, ref object F)
    {
        // Write your logic here

        _weight = Weight;
        _func = WeightedSum;

        F = _func;
    }

    static public double WeightedSum(double a, double b)
    {
        return -_weight * a + (1 - _weight) * b;
    }
}
# ---------- end weightedsumdelegate ----------
customfunction = RunCustomFunctionTwo(VoxelData1=spatialcorrelation, Function=weightedsumdelegate.F)  # disabled

clampvoxelvalues = ClampVoxelValues(VoxelData=voxelisedata, Range=dom_2)
c_script = CSharpScript(p=Slider(1.96, range=-24..24))  # -> out, a; inputs p: Double
# ---------- c_script: C# ----------
// Grasshopper Script Instance
#region Usings
using System;
using System.Linq;
using System.Collections;
using System.Collections.Generic;
using System.Drawing;

using Rhino;
using Rhino.Geometry;

using Grasshopper;
using Grasshopper.Kernel;
using Grasshopper.Kernel.Data;
using Grasshopper.Kernel.Types;
#endregion

public class Script_Instance : GH_ScriptInstance
{
    #region Notes
    /* 
      Members:
        RhinoDoc RhinoDocument
        GH_Document GrasshopperDocument
        IGH_Component Component
        int Iteration

      Methods (Virtual & overridable):
        Print(string text)
        Print(string format, params object[] args)
        Reflect(object obj)
        Reflect(object obj, string method_name)
    */
    #endregion

    static double Threshold;
    static Func<double, double> DelegateFunction;

    private void RunScript(double p, ref object a)
    {
        Threshold = p;

        a = new Func<double, double>(ThresholdGreater);
    }

    static double ThresholdGreater(double v)
    {
        return v > Threshold ? 1 : 0;
    }
}
# ---------- end c_script ----------
c_script_2 = CSharpScript(MinParam=Slider(0.2, range=0..0.7), MaxParam=Slider(0, range=0..0.3))  # -> out, Mapped; inputs Values: tree of Double, MinParam: Double, MaxParam: Double
# ---------- c_script_2: C# ----------
// Grasshopper Script Instance
#region Usings
using System;
using System.Linq;
using System.Collections;
using System.Collections.Generic;
using System.Drawing;

using Rhino;
using Rhino.Geometry;

using Grasshopper;
using Grasshopper.Kernel;
using Grasshopper.Kernel.Data;
using Grasshopper.Kernel.Types;
#endregion

public class Script_Instance : GH_ScriptInstance
{
    #region Notes
    /* 
      Members:
        RhinoDoc RhinoDocument
        GH_Document GrasshopperDocument
        IGH_Component Component
        int Iteration

      Methods (Virtual & overridable):
        Print(string text)
        Print(string format, params object[] args)
        Reflect(object obj)
        Reflect(object obj, string method_name)
    */
    #endregion

    private void RunScript(
		DataTree<double> Values,
		double MinParam,
		double MaxParam,
		ref object Mapped)
    {
        DataTree<double> outValues = new DataTree<double>();

        double dataMin = double.MaxValue;
        double dataMax = double.MinValue;

        foreach (var path in Values.Paths)
        {
            outValues.EnsurePath(path);
            var pathItems = Values.Branch(path);
            foreach (var value in pathItems)
            {
                if (value < dataMin) dataMin = value;
                if (value > dataMax) dataMax = value;
            }
        }

        foreach (var path in Values.Paths)
        {
            outValues.EnsurePath(path);
            var pathItems = Values.Branch(path);
            double[] outItems = new double[pathItems.Count];

            for (int i = 0; i < pathItems.Count; i++)
            {
                double value = pathItems[i];
                outItems[i] = Math.Max(Math.Min(Remap(value, dataMin, dataMax), MinParam), MaxParam);
            }
            outValues.AddRange(outItems, path);
        }
        Mapped = outValues;
    }

    private static double Remap(double x, double min, double max)
    {
        return (x - min) / (max - min);
    }
}
# ---------- end c_script_2 ----------
maxminnormalisevoxels = MaxMinNormaliseVoxels(VoxelData=clampvoxelvalues, Range=dom_2)
dom_3 = ConstructDomain(DomainStart=Slider(0.008, range=0..0.01084), DomainEnd=Slider(0.01084, range=0..0.01084))
explodevoxels = ExplodeVoxels(VoxelData=maxminnormalisevoxels)  # -> VoxelCentres, VoxelIndices, VoxelValues
domcen = CenteredDomain(DomainSize=Slider(2, range=0..10))
number_slider_5 = Slider(1, range=0..1)
bounds = Bounds(Numbers=flatten(explodevoxels.VoxelValues))
relay = Relay()
remap_2 = RemapNumbers(Value=explodevoxels.VoxelValues, Source=bounds, Target=Domain(0, 1))  # -> Mapped, Clipped; disabled
pdecon = Deconstruct(Point=graft(explodevoxels.VoxelIndices))  # -> XComponent, YComponent, ZComponent; disabled
construct_domain = ConstructDomain(DomainStart=Slider(0, range=0..1), DomainEnd=Slider(1, range=0..1))
voxelpreview = VoxelPreview(VoxelData=maxminnormalisevoxels, ScalarRange=bounds, PointWeight=5)  # disabled
bar_graph_2 = BarGraph(explodevoxels.VoxelValues, BarColor=RGB(255, 0, 90))
merge = Merge(Data1=pdecon.XComponent, Data2=pdecon.YComponent, Data3=pdecon.ZComponent, Data4=graft(remap_2.Mapped))  # disabled
dom_4 = ConstructDomain(DomainStart=Slider(0, range=0..0.5), DomainEnd=Slider(1, range=0..1))
join = TextJoin(Text=merge, Join=",")
trim = TrimTree(Tree=join, Depth=1)
panel_5 = Panel("""C:\Users\tobyw\low_voxels1.csv
C:\Users\tobyw\low_voxels2.csv
C:\Users\tobyw\low_voxels3.csv
C:\Users\tobyw\low_voxels4.csv
C:\Users\tobyw\low_voxels5.csv
C:\Users\tobyw\low_voxels6.csv
C:\Users\tobyw\low_voxels7.csv
C:\Users\tobyw\low_voxels8.csv
C:\Users\tobyw\low_voxels9.csv
C:\Users\tobyw\low_voxels10.csv
C:\Users\tobyw\low_voxels11.csv
C:\Users\tobyw\low_voxels12.csv""")
panel_6 = Panel("""C:\Users\tobyw\high_voxels1.csv
C:\Users\tobyw\high_voxels2.csv
C:\Users\tobyw\high_voxels3.csv
C:\Users\tobyw\high_voxels4.csv
C:\Users\tobyw\high_voxels5.csv
C:\Users\tobyw\high_voxels6.csv
C:\Users\tobyw\high_voxels7.csv
C:\Users\tobyw\high_voxels8.csv
C:\Users\tobyw\high_voxels9.csv
C:\Users\tobyw\high_voxels10.csv
C:\Users\tobyw\high_voxels11.csv
C:\Users\tobyw\high_voxels12.csv""")
ins = InsertItems(List=trim, Item="x,y,z,value", Indices=0, Wrap=True)
shift_2 = ShiftPaths(Data=ins, Offset=-1)
path = FilePath(graft(panel_6))
writetxt = WriteToTextFile(Run=Button(), TextToWrite=shift_2, FilePath=path, Append=False, NewOnly=True)
panel_7 = Panel(writetxt)
panel_8 = Panel("""C:\Users\tobyw\low_pores1.csv
C:\Users\tobyw\low_pores2.csv
C:\Users\tobyw\low_pores3.csv
C:\Users\tobyw\low_pores4.csv
C:\Users\tobyw\low_pores5.csv
C:\Users\tobyw\low_pores6.csv""")

# ----
# \\wsl.localhost\Ubuntu\home\toby_wilkinson\projects\IPMML\volume1.csv
# \\wsl.localhost\Ubuntu\home\toby_wilkinson\projects\IPMML\volume2.csv
# \\wsl.localhost\Ubuntu\home\toby_wilkinson\projects\IPMML\volume3.csv
# \\wsl.localhost\Ubuntu\home\toby_wilkinson\projects\IPMML\volume4.csv
# \\wsl.localhost\Ubuntu\home\toby_wilkinson\projects\IPMML\volume5.csv
# \\wsl.localhost\Ubuntu\home\toby_wilkinson\projects\IPMML\volume6.csv
# \\wsl.localhost\Ubuntu\home\toby_wilkinson\projects\IPMML\AE_volume1_low.csv
# \\wsl.localhost\Ubuntu\home\toby_wilkinson\projects\IPMML\AE_volume2_low.csv
# \\wsl.localhost\Ubuntu\home\toby_wilkinson\projects\IPMML\AE_volume3_low.csv
# \\wsl.localhost\Ubuntu\home\toby_wilkinson\projects\IPMML\AE_volume4_low.csv
# \\wsl.localhost\Ubuntu\home\toby_wilkinson\projects\IPMML\AE_volume5_low.csv
# \\wsl.localhost\Ubuntu\home\toby_wilkinson\projects\IPMML\AE_volume6_low.csv
# \\wsl.localhost\Ubuntu\home\toby_wilkinson\projects\IPMML\AE_volume1_high.csv
# \\wsl.localhost\Ubuntu\home\toby_wilkinson\projects\IPMML\AE_volume2_high.csv
# \\wsl.localhost\Ubuntu\home\toby_wilkinson\projects\IPMML\AE_volume3_high.csv
# \\wsl.localhost\Ubuntu\home\toby_wilkinson\projects\IPMML\AE_volume4_high.csv
# \\wsl.localhost\Ubuntu\home\toby_wilkinson\projects\IPMML\AE_volume5_high.csv
# \\wsl.localhost\Ubuntu\home\toby_wilkinson\projects\IPMML\AE_volume6_high.csv
# \\wsl.localhost\Ubuntu\home\toby_wilkinson\projects\IPMML\vae_volume1.csv
# \\wsl.localhost\Ubuntu\home\toby_wilkinson\projects\IPMML\vae_volume2.csv
# \\wsl.localhost\Ubuntu\home\toby_wilkinson\projects\IPMML\vae_volume3.csv
# \\wsl.localhost\Ubuntu\home\toby_wilkinson\projects\IPMML\vae_volume4.csv
# \\wsl.localhost\Ubuntu\home\toby_wilkinson\projects\IPMML\vae_volume5.csv
# \\wsl.localhost\Ubuntu\home\toby_wilkinson\projects\IPMML\vae_volume6.csv
# \\wsl.localhost\Ubuntu\home\toby_wilkinson\projects\IPMML\training\Pores\High\high_pores1.csv
# \\wsl.localhost\Ubuntu\home\toby_wilkinson\projects\IPMML\training\Pores\High\high_pores2.csv
# \\wsl.localhost\Ubuntu\home\toby_wilkinson\projects\IPMML\training\Pores\High\high_pores3.csv
# \\wsl.localhost\Ubuntu\home\toby_wilkinson\projects\IPMML\training\Pores\High\high_pores4.csv
# \\wsl.localhost\Ubuntu\home\toby_wilkinson\projects\IPMML\training\Pores\High\high_pores5.csv
# \\wsl.localhost\Ubuntu\home\toby_wilkinson\projects\IPMML\training\Pores\High\high_pores6.csv
panel_9 = Panel("""\\wsl.localhost\Ubuntu\home\toby_wilkinson\projects\IPMML\vae_volume1.csv
\\wsl.localhost\Ubuntu\home\toby_wilkinson\projects\IPMML\vae_volume2.csv
\\wsl.localhost\Ubuntu\home\toby_wilkinson\projects\IPMML\vae_volume3.csv
\\wsl.localhost\Ubuntu\home\toby_wilkinson\projects\IPMML\vae_volume4.csv
\\wsl.localhost\Ubuntu\home\toby_wilkinson\projects\IPMML\vae_volume5.csv
\\wsl.localhost\Ubuntu\home\toby_wilkinson\projects\IPMML\vae_volume6.csv
\\wsl.localhost\Ubuntu\home\toby_wilkinson\projects\IPMML\vae_volume7.csv
\\wsl.localhost\Ubuntu\home\toby_wilkinson\projects\IPMML\vae_volume8.csv
\\wsl.localhost\Ubuntu\home\toby_wilkinson\projects\IPMML\vae_volume9.csv
\\wsl.localhost\Ubuntu\home\toby_wilkinson\projects\IPMML\vae_volume10.csv
\\wsl.localhost\Ubuntu\home\toby_wilkinson\projects\IPMML\vae_volume11.csv
\\wsl.localhost\Ubuntu\home\toby_wilkinson\projects\IPMML\vae_volume12.csv""")
panel_10 = Panel("""\\wsl.localhost\Ubuntu\home\toby_wilkinson\projects\IPMML\training\high_spatter\std\high_std_voxels1.csv
\\wsl.localhost\Ubuntu\home\toby_wilkinson\projects\IPMML\training\high_spatter\std\high_std_voxels2.csv""")
readvoxelsfromcsv = ReadVoxelsFromCSV(Filepath=graft(panel_9), VoxelSize=voxel_size)  # disabled
spatialcorrelation_2 = SpatialCorrelation(VoxelData=readvoxelsfromcsv, VoxelRadius=1)  # disabled
vector_xyz = VectorXYZ(XComponent=Slider(14, range=0..100), YComponent=0, ZComponent=0)  # -> Vector, Length
move = Move(Geometry=readvoxelsfromcsv, Motion=vector_xyz.Vector)  # -> Geometry, Transform
dom_5 = ConstructDomain(DomainStart=Slider(0, range=-3.6..45.6), DomainEnd=Slider(5, range=-3.6..45.6))
dom_6 = ConstructDomain(DomainStart=Slider(0.1, range=0..1), DomainEnd=Slider(1, range=0..1))
number_slider_6 = Slider(5, range=5..10)
dom_7 = ConstructDomain(DomainStart=Slider(0, range=0..0.014), DomainEnd=Slider(0.008, range=0..0.014))

clampvoxelvalues_2 = ClampVoxelValues(VoxelData=move.Geometry, Range=dom_4)

voxelisepores = VoxelisePores(PoreMeshes=disjoint, VoxelData=voxelisedata, KClosestPoints=Slider(30, range=1..30))
dom_8 = ConstructDomain(DomainStart=Slider(0, range=-2..2), DomainEnd=Slider(1, range=-2..2))
explodevoxels_2 = ExplodeVoxels(VoxelData=voxelisepores)  # -> VoxelCentres, VoxelIndices, VoxelValues
bnd_2 = Bounds(Numbers=flatten(explodevoxels_2.VoxelValues))
remapvoxels = RemapVoxels(VoxelData=voxelisepores, InputRange=bnd_2, RemapRange=dom_8)
construct_domain_2 = ConstructDomain(DomainStart=Slider(0, range=0..1), DomainEnd=Slider(1, range=0..1))
sigmoid = Sigmoid(VoxelData=remapvoxels, Slope=Slider(7, range=0..15))  # disabled
filtervoxels = FilterVoxels(VoxelData=remapvoxels, ScalarRange=construct_domain, RemoveZeros=False, Normalise=False)
vector_xyz_2 = VectorXYZ(XComponent=Slider(14, range=0..25), YComponent=0, ZComponent=0)  # -> Vector, Length
move_2 = Move(Geometry=remapvoxels, Motion=vector_xyz_2.Vector)  # -> Geometry, Transform

antiskew = RunCustomFunctionOne(VoxelData=voxelisepores, Function=log.a)  # disabled
clampvoxelvalues_3 = ClampVoxelValues(VoxelData=remapvoxels, Range=domcen)  # disabled

explodevoxels_3 = ExplodeVoxels(VoxelData=remapvoxels)  # -> VoxelCentres, VoxelIndices, VoxelValues
pdecon_2 = Deconstruct(Point=graft(explodevoxels_3.VoxelIndices))  # -> XComponent, YComponent, ZComponent; disabled
bar_graph_3 = BarGraph(explodevoxels_3.VoxelValues, BarColor=RGB(255, 0, 90))
merge_2 = Merge(
    Data1=pdecon_2.XComponent,
    Data2=pdecon_2.YComponent,
    Data3=pdecon_2.ZComponent,
    Data4=graft(explodevoxels_3.VoxelValues))  # disabled
join_2 = TextJoin(Text=merge_2, Join=",")
trim_2 = TrimTree(Tree=join_2, Depth=1)
ins_2 = InsertItems(List=trim_2, Item="x,y,z,value", Indices=0, Wrap=True)
panel_11 = Panel("""C:\Users\tobyw\high_pores1.csv
C:\Users\tobyw\high_pores2.csv
C:\Users\tobyw\high_pores3.csv
C:\Users\tobyw\high_pores4.csv
C:\Users\tobyw\high_pores5.csv
C:\Users\tobyw\high_pores6.csv""")
export = Button()
shift_3 = ShiftPaths(Data=ins_2, Offset=-1)
path_2 = FilePath(graft(panel_8))
writetxt_2 = WriteToTextFile(Run=export, TextToWrite=shift_3, FilePath=path_2, Append=False, NewOnly=False)
panel_12 = Panel(writetxt_2)

bnd_3 = Bounds(Numbers=flatten(explodevoxels_3.VoxelValues))

voxelpreview_2 = VoxelPreview(VoxelData=move_2.Geometry, ScalarRange=bnd_3, PointWeight=number_slider_6, ColourbarTitle="Porosity")

columnnormalisation_2 = ColumnNormalisation(VoxelData=voxelisedata)  # disabled
explodevoxels_4 = ExplodeVoxels(VoxelData=columnnormalisation_2)  # -> VoxelCentres, VoxelIndices, VoxelValues
stats = Statistics(Series=flatten(explodevoxels_4.VoxelValues))  # -> SampleMean, Median, Average, StandardDeviation, Skewness, Kurtosis, Variance
spatialcorrelation_3 = SpatialCorrelation(VoxelData=columnnormalisation_2, VoxelRadius=1, GlobalMean=stats.SampleMean, GlobalSTD=stats.StandardDeviation)
dom_9 = ConstructDomain(DomainStart=Slider(0.5, range=-19..24), DomainEnd=Slider(1.1, range=-11..24))
explodevoxels_5 = ExplodeVoxels(VoxelData=relay)  # -> VoxelCentres, VoxelIndices, VoxelValues
bar_graph_4 = BarGraph(explodevoxels_5.VoxelValues, BarColor=RGB(255, 0, 90))
bounds_2 = Bounds(Numbers=flatten(explodevoxels_5.VoxelValues))
voxelpreview_3 = VoxelPreview(VoxelData=relay, ScalarRange=bounds_2, PointWeight=5)  # disabled

nickname = RunCustomFunctionOne(VoxelData=spatialcorrelation_3, Function=c_script.a)

filtervoxels_2 = FilterVoxels(VoxelData=nickname, ScalarRange=dom_9, RemoveZeros=False, Normalise=False)

filtervoxels_3 = FilterVoxels(VoxelData=clampvoxelvalues_2, ScalarRange=dom_6, RemoveZeros=False, Normalise=False)
explodevoxels_6 = ExplodeVoxels(VoxelData=filtervoxels_3)  # -> VoxelCentres, VoxelIndices, flatten(VoxelValues)
bnd_4 = Bounds(Numbers=flatten(explodevoxels_6.VoxelValues))
correlationcoefficients = CorrelationCoefficients(VoxelData1=spatialcorrelation_3, VoxelData2=voxelisepores)  # -> PearsonCoefficient, PearsonP, SpearmanRankCoefficient, SpearmanP
bar_graph_5 = BarGraph(explodevoxels_6.VoxelValues, BarColor=RGB(255, 0, 90))
voxelpreview_4 = VoxelPreview(VoxelData=filtervoxels_3, ScalarRange=dom_4, PointWeight=number_slider_6, ColourbarTitle="Spatial Corr.")  # disabled
panel_13 = Panel(correlationcoefficients.SpearmanRankCoefficient)
